vi "Initialize app subroutine.gvi"   [LabVIEW NXG 3.1.0]
inputs:
  "Error In": error
outputs:
  "Error Out": error
panel controls:
  "Instrument Address Output Cluster": "Instrument Address Output Cluster.gtype"
  "All Paths Cluster": "All Paths Cluster.gtype" = {"Thorlabs Motor Serial Number File Path Out"=path "C:\\Users\\mgibert2\\Documents\\GitHub\\Rainbow_NXG\\Extra installers\\Thorlabs_Motors_Serial_Number.txt"}
types:
  T1 = cluster{"Element 1": "VISA Instr", "Element 2": string}
  "Arduino Detection cluster control.gtype" = cluster{"XZ Stage Arduino Address": "VISA Instr", "XZ Stage Arduino Detected?": bool, "Multiplexer Arduino Detected?": bool, "Multiplexer Arduino Address": "VISA Instr", "Arduinos List": T1[]}
  "Thorlabs Motors Serial Number In.gtype" = cluster{"Thorlabs Blue Motor": string, "Thorlabs Red Motor": string}
  "Instrument Address Output Cluster.gtype" = cluster{"Arduino Coms Info": "Arduino Detection cluster control.gtype", "Photodetector Names": string[], "Keythley Address": "VISA Instr", "Photodetector Detected?": bool, "Thorlabs Motors Detected?": bool, "Keithley Detected?": bool, "Thorlabs Motors Serial Number In": "Thorlabs Motors Serial Number In.gtype"}
  "All Paths Cluster.gtype" = cluster{"Thorlabs Motor Serial Number File Path Out": path}
uses:
  Rainbow Measurement Setup::Main Functions::Initialize App::Instruction Extractor Initialize.gvi
  Rainbow Measurement Setup::Main Functions::Instruction Queue::Current State::FGV Current State.gvi
  Rainbow Measurement Setup::Side Functions::Instrument Control::Thorlabs Motors::Thorlabs Serial Number Check.gvi
  Rainbow Measurement Setup::Side Functions::Global Abort::FGV Global Abort.gvi
  Rainbow Measurement Setup::Side Functions::Instrument Control::Arduino::XZ Stage Homed FGV.gvi
  Rainbow Measurement Setup::Side Functions::Instrument Control::Instruction Extractor Instruments to Detect.gvi
  Rainbow Measurement Setup::Side Functions::Instrument Control::Instrument Detector.gvi
diagram:
  case ($"Error In") {
    frame Error, Default {
      w1 = $"Error In"
    }
    frame No Error {
      call "Instruction Extractor Initialize.gvi"(Initialize app subroutine states="Reset Disabled/Enabled Controls", Error In=$"Error In") -> (Initialize app States array=w2, SubStates Output Array=w3, Error Out=w4)
      s1 = w4  # shift register
      for {
        w5 = each element of w2
        w6 = each element of w3
        call "FGV Current State.gvi"(Current State Instructions="Set current Substate", Current Substate=w6, Error In=s1) -> (Error Out=w7)
        case (w5) {
          frame "Read Configuration Files" {
            call "Thorlabs Serial Number Check.gvi"(Error In=w7) -> (Thorlabs Motors Serial Number Out=w9, Thorlabs Motor Serial Number File Path Out=w10, Error Out=w8)
            Property Node(instance in=$"Instrument Address Output Cluster", "Thorlabs Motors Serial Number In"=w9) -> (instance out=w11)
            $"Instrument Address Output Cluster" <- w11
            Property Node(instance in=$"All Paths Cluster", "Thorlabs Motor Serial Number File Path Out"=w10) -> (instance out=w12)
            $"All Paths Cluster" <- w12
          }
          frame "Reset Disabled/Enabled Controls", Default {
            w8 = w7
          }
          frame "Reset Doubles" {
            w8 = w7
          }
          frame "Reset Booleans" {
            w8 = w7
          }
          frame "Reset Strings" {
            w8 = w7
          }
          frame "Reset Global Variables" {
            call "FGV Global Abort.gvi"(Global Abort Instructions="Reset State", Error In=w7) -> (Error Out=w13)
            call "XZ Stage Homed FGV.gvi"(FGV Instructions="Reset State", Error In=w13) -> (Error Out=w8)
          }
          frame "Detect Instruments" {
            call "Instruction Extractor Instruments to Detect.gvi"(Instruments To Detect control="Photodetector", Error In=w7) -> (Instruments To Detecte Array=w14, Error Out=w15)
            s2 = w15  # shift register
            for {
              w16 = each element of w14
              call "Instrument Detector.gvi"(Instruments To Detect control=w16, Instrument Address Output Cluster In=$"Instrument Address Output Cluster", Error In=s2) -> (Instrument Address Output Cluster Out=w17, Error Out=w18)
              $"Instrument Address Output Cluster" <- w17
              call "FGV Global Abort.gvi"(Global Abort Instructions="Read Current State", Error In=w18) -> (Global Abort Out=w19, Error Out=w20)
              next s2 = w20
              stop if w19
            }
            w8 = s2
          }
        }
        call "FGV Global Abort.gvi"(Global Abort Instructions="Read Current State", Error In=w8) -> (Global Abort Out=w21, Error Out=w22)
        next s1 = w22
        stop if w21
      }
      w1 = s1
    }
  }
  $"Error Out" <- w1
