vi "MSpot Spectra file handling.gvi"   [LabVIEW NXG 5.0.0]
inputs:
  "Error In": error
  "Full MSpot Multispectral Data Array In": "Full MSpot Multispectral Data.gtype"[]
  "Modify File Operation": "Modify File Operation.gtype" = "Save TXT"
outputs:
  "Error Out": error
  "Full MSpot Multispectral Data Array Out": "Full MSpot Multispectral Data.gtype"[]
  "Found Any File?": bool
types:
  "MSpot Spectrum Data.gtype" = cluster{"M Spot Spectrum": cluster{"Wavelength": f64[], "Counts": f64[]}, "Blue Motor Position (mm)": f64, "Red Motor Position (mm)": f64}
  "Rainbow Sweep Types.gtype" = enum{"Red Sweep Closing", "Red Sweep Opening", "Blue Sweep Closing", "Blue Sweep Opening"}
  "Full MSpot Multispectral Data.gtype" = cluster{"MSpot Spectrum Data Array": "MSpot Spectrum Data.gtype"[], "Rainbow Sweep Types": "Rainbow Sweep Types.gtype"}
  "Modify File Operation.gtype" = enum{"Save TXT", "Load TXT"}
uses:
  Rainbow Measurement Setup::Main Functions::One Time Calibrations::MSpot Spectrum::File Handling::MSpot Folder Scan.gvi
  Rainbow Measurement Setup::Main Functions::One Time Calibrations::MSpot Spectrum::File Handling::Folder Scan Sweep type.gvi
  Rainbow Measurement Setup::Main Functions::One Time Calibrations::MSpot Spectrum::File Handling::MSpot Data Extractor.gvi
  Rainbow Measurement Setup::Main Functions::One Time Calibrations::MSpot Spectrum::File Handling::MSpot Folder Check.gvi
  Rainbow Measurement Setup::Side Functions::Utilities::Cell Naming::txt Extension adder.gvi
  Rainbow Measurement Setup::Main Functions::Modify TXT file::Modify Measurement TXT File.gvi
diagram:
  # This subVI Handles the Saving of all the MSpot Spectra Calibration Files
  case ($"Error In") {
    frame Error, Default {
      w1 = $"Error In"
      w2 = $"Full MSpot Multispectral Data Array In"
      w3 = default
    }
    frame No Error {
      case ($"Modify File Operation") {
        frame "Load TXT" {
          call "MSpot Folder Scan.gvi"(Error In=$"Error In") -> (Folder Path=w4, Folder Names=w5, Error Out=w6)
          s1 = w6  # shift register
          s2 = "Full MSpot Multispectral Data.gtype"[] []  # shift register
          s3 = 0  # shift register
          for {
            w7 = each element of w5
            call "Folder Scan Sweep type.gvi"(Folder Name In=w7, Error In=s1) -> (Foldername Out=w9, Sweep Type=w10, Is folder sweep type?=w11, Error Out=w12)
            case (w11) {
              frame False, Default {
                w13 = s3
                w14 = s2
                w15 = w12
                w16 = default
              }
              frame True {
                Array Index(array=s2) -> (out0[s3]=w17)
                Build Path(base path=w4, name or relative path=w9) -> (appended path=w18)
                List Folder(error in=w12, path=w18) -> (error out=w19, file names=w20, path out=w21)
                s4 = w19  # shift register
                s5 = "MSpot Spectrum Data.gtype"[] []  # shift register
                s6 = 0  # shift register
                for {
                  w22 = each element of w20
                  Build Path(base path=w21, name or relative path=w22) -> (appended path=w24)
                  Search And Replace String(input string=w22, search string="MSpot_Spectrum_Calibration") -> (number of replacements=w25)
                  Is Not Equal To 0(x=w25) -> w26
                  call "MSpot Data Extractor.gvi"(Filepath to load=w24, Sub Array Index In=s6, M Spot Spectrum Sub Array In=s5, Modify file operation=$"Modify File Operation", Calibration file?=w26, Error In=s4) -> (Sub Array Index Out=w27, M Spot Spectrum Sub Array Out=w28, File Found?=w29, Error Out=w30)
                  append w29 to w23
                  next s4 = w30
                  next s5 = w28
                  next s6 = w27
                }
                Property Node(instance in=w17, "MSpot Spectrum Data Array"=s5, "Rainbow Sweep Types"=w10) -> (instance out=w31)
                Insert Into Array(inArray=s2, new=w31) -> w14
                Or Array Elements(Boolean array=w23) -> (logical OR=w16)
                Increment(x=s3) -> w13
                w15 = s4
              }
            }
            append w16 to w8
            next s1 = w15
            next s2 = w14
            next s3 = w13
          }
          Or Array Elements(Boolean array=w8) -> (logical OR=w3)
          w1 = s1
          w2 = s2
        }
        frame "Save TXT", Default {
          s7 = $"Error In"  # shift register
          for {
            w32 = each element of $"Full MSpot Multispectral Data Array In"
            Property Node(instance in=w32) -> ("MSpot Spectrum Data Array"=w33, "Rainbow Sweep Types"=w34)
            call "MSpot Folder Check.gvi"(Rainbow Sweep Types=w34, Error In=s7) -> (Folder Out=w35, Error Out=w36)
            s8 = w36  # shift register
            for {
              w37 = each element of w33
              Property Node(instance in=w37) -> ("M Spot Spectrum"=w38, "Blue Motor Position (mm)"=w39, "Red Motor Position (mm)"=w40)
              Format Into String(w39) -> w41
              Format Into String(w40) -> w42
              Concatenate Strings("Blue Motor Position (mm): ", w41, "\t", "Red Motor Position (mm): ", w42) -> w43
              Format Into String(initString="MSpot_Spectrum_Calibration_Position_", w39) -> w44
              Concatenate Strings(w44, "_") -> w45
              Format Into String(initString=w45, w40) -> w46
              call "txt Extension adder.gvi"(Name without .txt=w46, Error In=s8) -> (Name with .txt=w47, Error Out=w48)
              Property Node(instance in=w38) -> ("Wavelength"=w49, "Counts"=w50)
              Build Array(w49, w50) -> w51
              Transpose 2D Array(2D array=w51) -> (transposed array=w52)
              Build Path(base path=w35, name or relative path=w47) -> (appended path=w53)
              call "Modify Measurement TXT File.gvi"(Filename to load/save=w53, Variable Header Info=w43, Modify File Operation=$"Modify File Operation", Data To Save=w52, Error In=w48, Measurement File Type="Light Calibration Dividing Wavelength Spectrum") -> (Error Out=w54)
              next s8 = w54
            }
            next s7 = s8
          }
          w1 = s7
          w2 = $"Full MSpot Multispectral Data Array In"
          w3 = default
        }
      }
    }
  }
  $"Full MSpot Multispectral Data Array Out" <- w2
  $"Error Out" <- w1
  $"Found Any File?" <- w3
