vi "MSpot Spectrum Rainbow Sweep Subroutine.gvi"   [LabVIEW NXG 5.0.0]
inputs:
  "Instrument Coms Info In": "Instrument Coms Info.gtype"
  "MSpot Spectrum Calibration Parameters": "MSpot Spectrum Calibration Parameters.gtype" = {"Min Position (mm)"=0, "Max Position (mm)"=10, "Position step size (mm)"=0.1}
  "Manual Input": bool
  "Rainbow Sweep Param Selector": "Rainbow Sweep Param Selector.gtype" = {0, 1100, 300, 1, 1, 0}
  "Error In": error
outputs:
  "Instrument Coms Info Out": "Instrument Coms Info.gtype"
  "Full MSpot Multispectral Data Array": "Full MSpot Multispectral Data.gtype"[]
  "Error Out": error
types:
  "Raibow Sweep Selector.gtype" = enum{"Red Sweep", "Blue Sweep", "Full Sweep Red First", "Full Sweep Blue First"}
  "Rainbow Sweep Type Selector.gtype" = cluster{"Red Sweep Mode": enum{"Red Sweep Closing", "Red Sweep Opening"}, "Blue Sweep Mode": enum{"Blue Sweep Opening", "Blue Sweep Closing"}}
  "Rainbow Sweep Param Selector.gtype" = cluster{"Raibow Sweep Selector": "Raibow Sweep Selector.gtype", "Max Wavelength (nm)": f64, "Min Wavelength (nm)": f64, "Wavelength Step (nm)": f64, "Rainbow Sweep Types": "Rainbow Sweep Type Selector.gtype"}
  "MSpot Spectrum Data.gtype" = cluster{"M Spot Spectrum": cluster{"Wavelength": f64[], "Counts": f64[]}, "Blue Motor Position (mm)": f64, "Red Motor Position (mm)": f64}
  "Rainbow Sweep Types.gtype" = enum{"Red Sweep Closing", "Red Sweep Opening", "Blue Sweep Closing", "Blue Sweep Opening"}
  "Full MSpot Multispectral Data.gtype" = cluster{"MSpot Spectrum Data Array": "MSpot Spectrum Data.gtype"[], "Rainbow Sweep Types": "Rainbow Sweep Types.gtype"}
  T1 = cluster{"Element 1": "VISA Instr", "Element 2": string}
  "Arduino Detection cluster control.gtype" = cluster{"XZ Stage Arduino Address": "VISA Instr", "XZ Stage Arduino Detected?": bool, "Multiplexer Arduino Detected?": bool, "Multiplexer Arduino Address": "VISA Instr", "Arduinos List": T1[], "XZ Stage Log": string, "Multiplexer Log": string}
  "Thorlabs Motors Serial Number In.gtype" = cluster{"Thorlabs Blue Motor": string, "Thorlabs Red Motor": string, "Blue Motor Homed?": bool, "Red Motor Homed?": bool}
  "Instrument Coms Info.gtype" = cluster{"Arduino Coms Info": "Arduino Detection cluster control.gtype", "Photodetector Names": string[], "Keythley Address": "VISA Instr", "Photodetector Detected?": bool, "Thorlabs Motors Detected?": bool, "Keithley Detected?": bool, "Thorlabs Motors Serial Number": "Thorlabs Motors Serial Number In.gtype", "Photodetector IVI session": "Ivi IviDefault"}
  "MSpot Spectrum Calibration Parameters.gtype" = cluster{"Min Position (mm)": f64, "Max Position (mm)": f64, "Position step size (mm)": f64}
uses:
  Rainbow Measurement Setup::Side Functions::Rainbow Sweep::Rainbow Sweep Type Extractor.gvi
  NXG_KCube_DC_Servo_Control::Utilities::Initialize Motor and Home.gvi
  NXG_KCube_DC_Servo_Control::Utilities::Move To Position.gvi
  Rainbow Measurement Setup::Main Functions::One Time Calibrations::MSpot Spectrum::Random Data Generator.gvi
  NXG_KCube_DC_Servo_Control::Utilities::Disconnect Motor.gvi
diagram:
  # This SubVI Performs a scan of the spectrum of the beam (STILL FLAME CONNECTION MISSING) and then moves the blade motors to perform a full scan of the spectrum with respect to position.
  case ($"Error In") {
    frame Error, Default {
      w1 = default
      w2 = $"Error In"
      w3 = $"Instrument Coms Info In"
    }
    frame No Error {
      Property Node(instance in=$"MSpot Spectrum Calibration Parameters") -> ("Min Position (mm)"=w4, "Max Position (mm)"=w5, "Position step size (mm)"=w6)
      call "Rainbow Sweep Type Extractor.gvi"(Rainbow Sweep Parameters=$"Rainbow Sweep Param Selector", Error In=$"Error In") -> (Rainbow Sweep Array=w7, Error Out=w8)
      Subtract(x=w5, y=w4) -> w9
      Divide(x=w9, y=w6) -> w10
      Increment(x=w10) -> w11
      To Signed 32 Bit Integer(number=w11) -> w12
      # w12: Number of Steps
      s1 = "Full MSpot Multispectral Data.gtype"[] []  # shift register
      s2 = w8  # shift register
      s3 = $"Instrument Coms Info In"  # shift register
      for (iteration -> i1) {
        w13 = each element of w7
        Array Index(array=s1) -> (out0[i1]=w14)
        case (w13) {
          frame "Red Sweep Opening", Default {
            Property Node(instance in=s3) -> ("Thorlabs Motors Serial Number:Thorlabs Blue Motor"=w18, "Thorlabs Motors Serial Number:Blue Motor Homed?"=w19, instance out=w20)
            call "Initialize Motor and Home.gvi"(Current Motor Serial nº In=w18, Homed? In=w19, Error In=s2) -> (Current Motor Serial nº Out=w21, Homed? Out=w22, Error Out=w23)
            Property Node(instance in=w20, "Thorlabs Motors Serial Number:Blue Motor Homed?"=w22) -> (instance out=w15)
            s4 = w21  # shift register
            s5 = w23  # shift register
            s6 = "MSpot Spectrum Data.gtype"[] []  # shift register
            for (N = w12) (iteration -> i2) {
              case ($"Manual Input") {
                frame False, Default { }
                frame True {
                  Wait Until Next Multiple(multiple to wait=300)
                  w24 = "Please Save the spectrum file\non the oceanview software\nbefore continuing."
                  One Button Dialog(button name ("OK")="Okay, I will", message=w24)
                }
              }
              To Double Precision Float(number=i2) -> w25
              Multiply(w6, w25) -> w26
              Subtract(x=w5, y=w26) -> w27
              call "Move To Position.gvi"(Motor Serial Number In=s4, Position to move in mm=w27, Error In=s5) -> (Current Motor Serial nº=w28, Error Out=w29)
              call "Random Data Generator.gvi"() -> (Beam Spectrum=w30)
              Property Node(instance in="MSpot Spectrum Data.gtype" {all zero or empty}, "M Spot Spectrum"=w30, "Blue Motor Position (mm)"=w27, "Red Motor Position (mm)"=0) -> (instance out=w31)
              Insert Into Array(inArray=s6, index0=i2, new=w31) -> w32
              next s4 = w28
              next s5 = w29
              next s6 = w32
            }
            call "Disconnect Motor.gvi"(Motor Serial nº=s4, Error In=s5) -> (Error Out=w16)
            Property Node(instance in=w14, "Rainbow Sweep Types"=w13, "MSpot Spectrum Data Array"=s6) -> (instance out=w17)
          }
          frame "Red Sweep Closing" {
            Property Node(instance in=s3) -> ("Thorlabs Motors Serial Number:Thorlabs Blue Motor"=w33, "Thorlabs Motors Serial Number:Blue Motor Homed?"=w34, instance out=w35)
            call "Initialize Motor and Home.gvi"(Current Motor Serial nº In=w33, Homed? In=w34, Error In=s2) -> (Current Motor Serial nº Out=w36, Homed? Out=w37, Error Out=w38)
            Property Node(instance in=w35, "Thorlabs Motors Serial Number:Blue Motor Homed?"=w37) -> (instance out=w15)
            s7 = w36  # shift register
            s8 = w38  # shift register
            s9 = "MSpot Spectrum Data.gtype"[] []  # shift register
            for (N = w12) (iteration -> i3) (after w5) {
              case ($"Manual Input") {
                frame False, Default { }
                frame True {
                  Wait Until Next Multiple(multiple to wait=300)
                  w39 = "Please Save the spectrum file\non the oceanview software\nbefore continuing."
                  One Button Dialog(button name ("OK")="Okay, I will", message=w39)
                }
              }
              To Double Precision Float(number=i3) -> w40
              Multiply(w6, w40) -> w41
              Add(w4, w41) -> w42
              call "Move To Position.gvi"(Motor Serial Number In=s7, Position to move in mm=w42, Error In=s8) -> (Current Motor Serial nº=w43, Error Out=w44)
              w45 = cluster{"Wavelength": f64[], "Counts": f64[]} {"Wavelength"=[2, 3, 4], "Counts"=[5, 6, 7]}
              Property Node(instance in="MSpot Spectrum Data.gtype" {all zero or empty}, "M Spot Spectrum"=w45, "Blue Motor Position (mm)"=w42, "Red Motor Position (mm)"=0) -> (instance out=w46)
              Insert Into Array(inArray=s9, index0=i3, new=w46) -> w47
              next s7 = w43
              next s8 = w44
              next s9 = w47
            }
            call "Disconnect Motor.gvi"(Motor Serial nº=s7, Error In=s8) -> (Error Out=w16)
            Property Node(instance in=w14, "Rainbow Sweep Types"=w13, "MSpot Spectrum Data Array"=s9) -> (instance out=w17)
          }
          frame "Blue Sweep Closing" {
            Property Node(instance in=s3) -> ("Thorlabs Motors Serial Number:Thorlabs Red Motor"=w48, "Thorlabs Motors Serial Number:Red Motor Homed?"=w49, instance out=w50)
            call "Initialize Motor and Home.gvi"(Current Motor Serial nº In=w48, Homed? In=w49, Error In=s2) -> (Current Motor Serial nº Out=w51, Homed? Out=w52, Error Out=w53)
            Property Node(instance in=w50, "Thorlabs Motors Serial Number:Red Motor Homed?"=w52) -> (instance out=w15)
            s10 = w51  # shift register
            s11 = w53  # shift register
            s12 = "MSpot Spectrum Data.gtype"[] []  # shift register
            for (N = w12) (iteration -> i4) (after w5) {
              case ($"Manual Input") {
                frame False, Default { }
                frame True {
                  Wait Until Next Multiple(multiple to wait=300)
                  w54 = "Please Save the spectrum file\non the oceanview software\nbefore continuing."
                  One Button Dialog(button name ("OK")="Okay, I will", message=w54)
                }
              }
              To Double Precision Float(number=i4) -> w55
              Multiply(w6, w55) -> w56
              Add(w4, w56) -> w57
              call "Move To Position.gvi"(Motor Serial Number In=s10, Position to move in mm=w57, Error In=s11) -> (Current Motor Serial nº=w58, Error Out=w59)
              w60 = cluster{"Wavelength": f64[], "Counts": f64[]} {"Wavelength"=[2, 3, 4], "Counts"=[5, 6, 7]}
              Property Node(instance in="MSpot Spectrum Data.gtype" {all zero or empty}, "M Spot Spectrum"=w60, "Red Motor Position (mm)"=w57, "Blue Motor Position (mm)"=0) -> (instance out=w61)
              Insert Into Array(inArray=s12, index0=i4, new=w61) -> w62
              next s10 = w58
              next s11 = w59
              next s12 = w62
            }
            call "Disconnect Motor.gvi"(Motor Serial nº=s10, Error In=s11) -> (Error Out=w16)
            Property Node(instance in=w14, "Rainbow Sweep Types"=w13, "MSpot Spectrum Data Array"=s12) -> (instance out=w17)
          }
          frame "Blue Sweep Opening" {
            Property Node(instance in=s3) -> ("Thorlabs Motors Serial Number:Thorlabs Red Motor"=w63, "Thorlabs Motors Serial Number:Red Motor Homed?"=w64, instance out=w65)
            call "Initialize Motor and Home.gvi"(Current Motor Serial nº In=w63, Homed? In=w64, Error In=s2) -> (Current Motor Serial nº Out=w66, Homed? Out=w67, Error Out=w68)
            Property Node(instance in=w65, "Thorlabs Motors Serial Number:Red Motor Homed?"=w67) -> (instance out=w15)
            s13 = w66  # shift register
            s14 = w68  # shift register
            s15 = "MSpot Spectrum Data.gtype"[] []  # shift register
            for (N = w12) (iteration -> i5) (after w4) {
              case ($"Manual Input") {
                frame False, Default { }
                frame True {
                  Wait Until Next Multiple(multiple to wait=300)
                  w69 = "Please Save the spectrum file\non the oceanview software\nbefore continuing."
                  One Button Dialog(button name ("OK")="Okay, I will", message=w69)
                }
              }
              To Double Precision Float(number=i5) -> w70
              Multiply(w6, w70) -> w71
              Subtract(x=w5, y=w71) -> w72
              call "Move To Position.gvi"(Motor Serial Number In=s13, Position to move in mm=w72, Error In=s14) -> (Current Motor Serial nº=w73, Error Out=w74)
              w75 = cluster{"Wavelength": f64[], "Counts": f64[]} {"Wavelength"=[2, 3, 4], "Counts"=[5, 6, 7]}
              Property Node(instance in="MSpot Spectrum Data.gtype" {all zero or empty}, "M Spot Spectrum"=w75, "Red Motor Position (mm)"=w72, "Blue Motor Position (mm)"=0) -> (instance out=w76)
              Insert Into Array(inArray=s15, index0=i5, new=w76) -> w77
              next s13 = w73
              next s14 = w74
              next s15 = w77
            }
            call "Disconnect Motor.gvi"(Motor Serial nº=s13, Error In=s14) -> (Error Out=w16)
            Property Node(instance in=w14, "Rainbow Sweep Types"=w13, "MSpot Spectrum Data Array"=s15) -> (instance out=w17)
          }
        }
        Insert Into Array(inArray=s1, index0=i1, new=w17) -> w78
        next s1 = w78
        next s2 = w16
        next s3 = w15
      }
      w1 = s1
      w2 = s2
      w3 = s3
    }
  }
  $"Instrument Coms Info Out" <- w3
  $"Error Out" <- w2
  $"Full MSpot Multispectral Data Array" <- w1
