vi "MSpot Spectrum Visualizer.gvi"   [LabVIEW NXG 5.0.0]
inputs:
  "Error In": error
  "Full MSpot Multispectral Data Array": "Full MSpot Multispectral Data.gtype"[]
outputs:
  "Error Out": error
panel controls:
  "Sweep Type Selector": i32
  "Graph (position) Selector": i32
  "Continue": bool
panel indicators:
  "Rainbow Sweep Type": "Rainbow Sweep Types.gtype"
  "M Spot Spectrum": cluster{"Element 1": f64[], "Element 2": f64[]}
  "MSpot Spectrum Data": "MSpot Spectrum Data.gtype"
types:
  "Rainbow Sweep Types.gtype" = enum{"Red Sweep Closing", "Red Sweep Opening", "Blue Sweep Closing", "Blue Sweep Opening"}
  "MSpot Spectrum Data.gtype" = cluster{"M Spot Spectrum": cluster{"Wavelength": f64[], "Counts": f64[]}, "Blue Motor Position (mm)": f64, "Red Motor Position (mm)": f64}
  "Full MSpot Multispectral Data.gtype" = cluster{"MSpot Spectrum Data Array": "MSpot Spectrum Data.gtype"[], "Rainbow Sweep Types": "Rainbow Sweep Types.gtype"}
diagram:
  Property Node(instance in=reference to unnamed native front panel, error in=$"Error In") -> ("Window"=w1, error out=w2)
  Open Window(reference in=w1, error in=w2) -> (reference out=w3, error out=w4)
  # This subVI allows us to visualize the data obtained on the Measuring Spot Spectrum Calibration subroutine so that we can
  # extract our own conclusions and elaborate the calibration file.
  case (w4) {
    frame Error, Default {
      w5 = w4
    }
    frame No Error {
      while {
        Array Size(array=$"Full MSpot Multispectral Data Array") -> (size(s)=w6)
        Decrement(x=w6) -> w7
        Is Equal To 0(x=w7) -> w8
        Not(x=w8) -> w9
        Property Node(instance in=reference to "Sweep Type Selector", "Maximum"=w7, "Minimum"=0, "Visible"=w9, error in=w4) -> (error out=w10)
        Array Index(array=$"Full MSpot Multispectral Data Array") -> (out0[$"Sweep Type Selector"]=w11)
        Property Node(instance in=w11) -> ("MSpot Spectrum Data Array"=w12, "Rainbow Sweep Types"=w13)
        Array Size(array=w12) -> (size(s)=w14)
        Decrement(x=w14) -> w15
        Property Node(instance in=reference to "Graph (position) Selector", "Minimum"=0, "Maximum"=w15, error in=w10) -> (error out=w5)
        Array Index(array=w12) -> (out0[$"Graph (position) Selector"]=w16)
        $"MSpot Spectrum Data" <- w16
        Property Node(instance in=w16) -> ("M Spot Spectrum"=w17)
        Property Node(instance in=w17) -> ("Wavelength"=w18, "Counts"=w19)
        Build Cluster(w18, w19) -> w20
        $"M Spot Spectrum" <- w20
        Wait Until Next Multiple(multiple to wait=50)
        $"Rainbow Sweep Type" <- w13
        stop if $Continue
      }
    }
  }
  Close Window(reference in=w3, error in=w5) -> (error out=w21)
  $"Error Out" <- w21
