vi "Light Power Calibration Sweep.gvi"   [LabVIEW NXG 5.0.0]
inputs:
  "Error In": error
  "Instrument Control Mega Cluster In": "Instrument Control Mega Cluster.gtype"
  "LPC Mega Cluster In": "LPC Mega Cluster.gtype"
outputs:
  "Error Out": error
  "LPC Mega Cluster Out": "LPC Mega Cluster.gtype"
  "Instrument Control Mega Cluster Out": "Instrument Control Mega Cluster.gtype"
types:
  "Instrument Coms Info.gtype" = cluster{"Arduino Coms Info": "Arduino Detection cluster control.gtype", "Photodetector Names": string[], "Keythley Address": "VISA Instr", "Photodetector Detected?": bool, "Thorlabs Motors Detected?": bool, "Keithley Detected?": bool, "Thorlabs Motors Serial Number": "Thorlabs Motors Serial Number In.gtype", "Photodetector IVI session": "Ivi IviDefault", "Flame ID": string, "Flame Detected?": bool, "Flame Wrapper ID": u64}
  "Debugging Cluster.gtype" = cluster{"Debugging mode?": bool, "Initialize App": bool, "Insturment Debugging": "Insturment Debugging Cluster.gtype"}
  "Instrument Control Mega Cluster.gtype" = cluster{"Instruments Coms Info": "Instrument Coms Info.gtype", "Debugging Cluster": "Debugging Cluster.gtype"}
  "Raibow Sweep Selector.gtype" = enum{"Red Sweep", "Blue Sweep", "Full Sweep Red First", "Full Sweep Blue First"}
  "Rainbow Sweep Param Selector.gtype" = cluster{"Raibow Sweep Selector": "Raibow Sweep Selector.gtype", "Max Wavelength (nm)": f64, "Min Wavelength (nm)": f64, "Wavelength Step (nm)": f64, "Rainbow Sweep Type Selector": "Rainbow Sweep Type Selector.gtype"}
  T1 = cluster{"Dividing Wavelength Array": f64[], "Measured Power Array": f64[]}
  "Rainbow Sweep Types.gtype" = enum{"Red Sweep Closing", "Red Sweep Opening", "Blue Sweep Closing", "Blue Sweep Opening"}
  "Light Power Calibration Data.gtype" = cluster{"Single Light Calibration": T1, "Rainbow Sweep Types": "Rainbow Sweep Types.gtype"}
  "Light power Calibration Parameters.gtype" = cluster{"Powermeter Averages": f64}
  "LPC Mega Cluster.gtype" = cluster{"Rainbow Sweep Parameters LPC": "Rainbow Sweep Param Selector.gtype", "Light Power Calibration Data": "Light Power Calibration Data.gtype"[], "LPC Specific Parameters": "Light power Calibration Parameters.gtype"}
  "LPC Sweep Live Parameters.gtype" = cluster{"Light Power (W) ": f64, "Current Wavelength (nm)": f64, "Rainbow Sweep Types": "Rainbow Sweep Types.gtype"}
uses:
  Rainbow Measurement Setup::Side Functions::Messages And Prompts::FGV Cancel Prompts until Finished Routine.gvi
  Rainbow Measurement Setup::Side Functions::Rainbow Sweep::Rainbow Sweep Param Generator.gvi
  Rainbow Measurement Setup::Side Functions::Instrument Control::Thorlabs Motors::Dividing Wavelength Control::Dividing Wavelength Calibration Data FGV.gvi
  Rainbow Measurement Setup::Side Functions::Global Abort::FGV Global Abort.gvi
  Rainbow Measurement Setup::Side Functions::Instrument Control::Thorlabs Motors::Dividing Wavelength Control::KCube Dividing Wavelength Translator.gvi
  Rainbow Measurement Setup::Side Functions::Utilities::Wait ms.gvi
  Rainbow Measurement Setup::Side Functions::Instrument Control::Photodetector::Photodetector Measure Power.gvi
  Rainbow Measurement Setup::Side Functions::Graphing::Multiple Page Graph Adapter.gvi
  Rainbow Measurement Setup::Main Functions::Rainbow Measurement::Light Power Calibration::Light Calibration Live Parameters FGV.gvi
  Rainbow Measurement Setup::Side Functions::Utilities::Progress Handling::Progress General Calculator.gvi
  Rainbow Measurement Setup::Side Functions::Utilities::Progress Handling::Progress FGV.gvi
diagram:
  # This SubVI Performs a sweep moving the motors and measuring the power that reaches the detector and then it stores everything on an array so that it can be later saved.
  case ($"Error In") {
    frame Error, Default {
      w1 = $"Error In"
      w2 = $"Instrument Control Mega Cluster In"
      w3 = $"LPC Mega Cluster In"
    }
    frame No Error {
      Property Node(instance in=$"LPC Mega Cluster In") -> ("Rainbow Sweep Parameters LPC"=w4, instance out=w5)
      Property Node(instance in=$"Instrument Control Mega Cluster In") -> ("Debugging Cluster:Insturment Debugging:Photodetector"=w6, "Debugging Cluster:Debugging mode?"=w7, instance out=w8)
      call "FGV Cancel Prompts until Finished Routine.gvi"(Error In=$"Error In", FGV Instructions="Reset State") -> (Error Out=w9)
      call "Rainbow Sweep Param Generator.gvi"(Rainbow Sweep Parameters=w4, Error In=w9) -> (Rainbow Sweep Parameters Array=w10, Error Out=w11)
      Logical And[output inverted](not w6, w7) -> w12
      Property Node(instance in=w4) -> ("Wavelength Step (nm)"=w13)
      Multiply(w13, 1000) -> w14
      Select(s=w12, t=w14, f=1) -> w15
      Array Size(array=w10) -> (size(s)=w16)
      Initialize Array(element="Light Power Calibration Data.gtype" {all zero or empty}, size=w16) -> w17
      call "Dividing Wavelength Calibration Data FGV.gvi"(Div Wavelength FGV Instructions="Read Loaded Data", Error In=w11) -> (Dividing Wavelength Calibration Data Out=w18, Error Out=w19)
      s1 = w19  # shift register
      s2 = w8  # shift register
      s3 = w17  # shift register
      s4 = 0  # shift register
      for (N -> w20) (iteration -> i1) {
        w21 = each element of w10
        Property Node(instance in=w21) -> ("Dividing Wavelength Array"=w22, "Rainbow Sweep Types"=w23)
        s5 = s1  # shift register
        s6 = s2  # shift register
        s7 = s4  # shift register
        s8 = s3  # shift register
        for (N -> w24) {
          w25 = each element of w22
          Increment(x=s7) -> w26
          Multiply(w24, w20) -> w27
          call "FGV Global Abort.gvi"(Global Abort Instructions="Read Current State", Error In=s5) -> (Local Abort Out=w28, Global Abort Out=w29, Error Out=w30)
          call "KCube Dividing Wavelength Translator.gvi"(Dividing Wavelength=w25, Instrument Control Mega Cluster In=s6, Dividing Wavelength Calibration Data In=w18, Error In=w30, Rainbow Sweep Types=w23) -> (Real Dividing Wavelength=w31, Instrument Control Mega Cluster Out=w32, Error Out=w33)
          call "Wait ms.gvi"(Error In=w33, Milliseconds to Wait=w15) -> (Error Out=w34)
          call "Photodetector Measure Power.gvi"(Instrument Control Mega Cluster In=w32, Error In=w34) -> (Instrument Control Mega Cluster Out=w35, Measured Power=w36, Error Out=w37)
          Property Node(instance in="LPC Sweep Live Parameters.gtype" {all zero or empty}, "Light Power (W) "=w36, "Current Wavelength (nm)"=w31, "Rainbow Sweep Types"=w23) -> (instance out=w38)
          Array Index(array=s8) -> (out0[i1]=w39)
          Property Node(instance in=w39) -> ("Single Light Calibration"=w40, instance out=w41)
          Property Node(instance in=w40) -> ("Dividing Wavelength Array"=w42, "Measured Power Array"=w43, instance out=w44)
          Build Array(w42, w31) -> w45
          Build Array(w43, w36) -> w46
          Property Node(instance in=w44, "Dividing Wavelength Array"=w45, "Measured Power Array"=w46) -> (instance out=w47)
          Property Node(instance in=w41, "Single Light Calibration"=w47, "Rainbow Sweep Types"=w23) -> (instance out=w48)
          Replace Array Subset(inArray=s8, index=i1, new=w48) -> w49
          call "Multiple Page Graph Adapter.gvi"(Full Data Array=w49, Error In=w37) -> (Output Bundled Data=w50, Output Graph Ready Data=w51, Error Out=w52)
          call "Light Calibration Live Parameters FGV.gvi"(FGV Instructions="Set State", Light Calibration Live Parameters In=w38, Output Graph Ready Data=w51, Error In=w52, Graph Bundled data=w50) -> (Error Out=w53)
          call "Progress General Calculator.gvi"(Starting Value=40, Ending Value=80, Number Of Steps=w27, Current Step=s7, Error In=w53) -> (Current Progress=w54, Error Out=w55)
          call "Progress FGV.gvi"(FGV Instructions="Set State", Progress In=w54, Error In=w55) -> (Error Out=w56)
          Logical Or(w28, w29) -> w57
          next s5 = w56
          next s6 = w35
          next s7 = w26
          next s8 = w49
          stop if w57
        }
        call "Multiple Page Graph Adapter.gvi"(Full Data Array=s8, Error In=s5) -> (Output Bundled Data=w58, Output Graph Ready Data=w59, Error Out=w60)
        call "Light Calibration Live Parameters FGV.gvi"(FGV Instructions="Set State", Light Calibration Live Parameters In=w38, Output Graph Ready Data=w59, Error In=w60, Graph Bundled data=w58) -> (Error Out=w61)
        next s1 = w61
        next s2 = s6
        next s3 = s8
        next s4 = s7
        stop if w57
      }
      Property Node(instance in=w5, "Light Power Calibration Data"=s3) -> (instance out=w3)
      call "Multiple Page Graph Adapter.gvi"(Full Data Array=s3, Error In=s1) -> (Output Bundled Data=w62, Output Graph Ready Data=w63, Error Out=w64)
      call "Light Calibration Live Parameters FGV.gvi"(FGV Instructions="Set State", Light Calibration Live Parameters In=w38, Output Graph Ready Data=w63, Error In=w64, Graph Bundled data=w62) -> (Error Out=w1)
      w2 = s2
    }
  }
  $"Instrument Control Mega Cluster Out" <- w2
  $"LPC Mega Cluster Out" <- w3
  $"Error Out" <- w1
